vi "Single EQE Measurement Acquire.gvi"   [LabVIEW NXG 5.0.0]
inputs:
  "Single acquire inputs control": "Single acquire inputs control.gtype"
  "Notifier In": Notifier<"Single Acquire Notification control.gtype">
  "Error In": error
outputs:
  "Error Out": error
  "Dark Current": f64
  "Full EQE Data": f64[][]
  "Notifier Out": Notifier<"Single Acquire Notification control.gtype">
panel indicators:
  "Current measurements": f64[]
  "spreadsheet string": string
types:
  "Single acquire inputs control.gtype" = cluster{"Light calibration data": f64[][], "Fiannium Configuration File": path, "Arduino Filter Flipper Address": "VISA Instr", "Filter Arduino Status": bool, "Dark Current Averages": f64, "Measure dark current?": bool, "Keithley Address": "VISA Instr", "Current Aveages": i32, "Voltage Applied (V)": f64, "Max current compliance": f64, "Manual Current Range": f64, "Enable Auto Range": bool, "Automatic measurement": bool, "Fiannium Pe Handler": u64, "Dead Cell? Current Threshold": f64, "Automatic measurement Cell Dark current": f64, "Monocrhomator": bool}
  "Single Acquire Notification control.gtype" = cluster{"Wavelength (nm)": f64, "EQE (%)": f64, "Current (A)": f64, "Finnished": bool, "Progress": f64}
uses:
  EQE_Measuring_Setup_NanOpto::SubVis::Instrument Control::Keithley::Keithley Initialization Sequence.gvi
  PE_Filter_SDK::Monochromator Initialization Sequence.gvi
  EQE_Measuring_Setup_NanOpto::SubVis::FGV::Current State FGV.gvi
  EQE_Measuring_Setup_NanOpto::SubVis::Instrument Control::Arduinos::Filter Flipper Arduino::Filter Plipper Arduino set to IR pass.gvi
  EQE_Measuring_Setup_NanOpto::SubVis::Instrument Control::Keithley::Dark current Measurement.gvi
  Keithley 2450 NXG Library::Public::Configure::Set Measurement Count.gvi
  EQE_Measuring_Setup_NanOpto::SubVis::Utilities::Other::Light Calibration parameters extractor.gvi
  EQE_Measuring_Setup_NanOpto::SubVis::Utilities::Other::Wavelength loop calculation.gvi
  EQE_Measuring_Setup_NanOpto::SubVis::Instrument Control::Monochromator::Filter Wavelength nm Crossing ka.gvi
  EQE_Measuring_Setup_NanOpto::SubVis::Instrument Control::Arduinos::Filter Flipper Arduino::Filter Flipper arduino flip subroutine.gvi
  Keithley 2450 NXG Library::Public::Configure::Clear Buffer.gvi
  Keithley 2450 NXG Library::Public::Configure::Configure Integration Filter.gvi
  Keithley 2450 NXG Library::Public::Action Status::Enable Output.gvi
  EQE_Measuring_Setup_NanOpto::SubVis::Main Sub Functions::Acquire::Single Acquire::Keithley adaptative measurement setup.gvi
  EQE_Measuring_Setup_NanOpto::SubVis::Utilities::Other::Wavelength detection filter flipper routine.gvi
  EQE_Measuring_Setup_NanOpto::SubVis::Main Sub Functions::Acquire::Single Acquire::Set Wavelength Function.gvi
  EQE_Measuring_Setup_NanOpto::SubVis::Main Sub Functions::Global Abort::Global Abort.gvi
  EQE_Measuring_Setup_NanOpto::SubVis::FGV::Skip To next Cell FGV.gvi
  Keithley 2450 NXG Library::Public::Data::Make Reading and Store in Buffer.gvi
  Keithley 2450 NXG Library::Public::Data::Read (Multiple Points).gvi
  NI::Analysis::Statistics::Mean (DBL).gvi
  EQE_Measuring_Setup_NanOpto::SubVis::Utilities::Messages And Prompts::Erase Notification Error.gvi
  Keithley 2450 NXG Library::Public::Close.gvi
  PE_Filter_SDK::PE Close.gvi
  PE_Filter_SDK::PE Destroy.gvi
diagram:
  Property Node(instance in=$"Single acquire inputs control") -> ("Enable Auto Range"=w1, "Fiannium Configuration File"=w2, "Arduino Filter Flipper Address"=w3, "Filter Arduino Status"=w4, "Dark Current Averages"=w5, "Measure dark current?"=w6, "Keithley Address"=w7, "Current Aveages"=w8, "Voltage Applied (V)"=w9, "Max current compliance"=w10, "Manual Current Range"=w11, "Automatic measurement"=w12, "Fiannium Pe Handler"=w13)
  Logical And(not w12, w6) -> w14
  case (w12) {
    frame True {
      # If it is an automatic measurement
      # both the keithley and the fiannium will have been
      # initialized
      call "Keithley Initialization Sequence.gvi"(Enable Auto Range=w1, VISA resource name=w7, Voltage Applied (V)=w9, Source Limit Level (0.1)=w10, Current Averages=w8, Error In=$"Error In", Manual Current Range=w11) -> (VISA resource name out=w15, Error Out=w17)
      w16 = w13
    }
    frame False {
      call "Keithley Initialization Sequence.gvi"(Enable Auto Range=w1, VISA resource name=w7, Voltage Applied (V)=w9, Source Limit Level (0.1)=w10, Current Averages=w8, Error In=$"Error In", Manual Current Range=w11) -> (VISA resource name out=w15, Error Out=w18)
      call "Monochromator Initialization Sequence.gvi"(Configuration File=w2, Error In=w18) -> (peHandle out=w16, Error Out=w17)
    }
  }
  case (w14) {
    frame False, Default {
      # If It is an automatic measurement or we do not want
      # to measure the dark current we just pass the info
      w19 = w15
      w20 = w17
      w21 = w16
    }
    frame True {
      call "Current State FGV.gvi"(Instruction Current State FGV="Set Current SubState", Current SubState="Measuring Dark Current", Error In=w17) -> (Error Out=w22)
      call "Filter Plipper Arduino set to IR pass.gvi"(Arduino Filter Flipper Address=w3, Filter Arduino Status=w4, Error In=w22) -> (Error Out=w23)
      call "Dark current Measurement.gvi"(Keithley Address=w15, Fiannium Pe Handler=w16, Close Coms after finish?=FALSE, Error In=w23, Dark Current Aveages=w5) -> (Dark current Value=w24, Pe Handle out=w21, Keythley address out=w25, Error Out=w26)
      $"Dark Current" <- w24
      call "Set Measurement Count.gvi"(VISA resource name=w25, Measurement Count=w8, error in (no error)=w26) -> (VISA resource name out=w19, error out=w20)
    }
  }
  case (w20) {
    frame Error, Default {
      w28 = "Single Acquire Notification control.gtype" {all zero or empty}
      Send Notification(notification=w28, notifier=$"Notifier In")
      w27 = w20
    }
    frame No Error {
      Property Node(instance in=$"Single acquire inputs control") -> ("Filter Arduino Status"=w29, "Arduino Filter Flipper Address"=w30, "Light calibration data"=w31, "Dead Cell? Current Threshold"=w32)
      call "Light Calibration parameters extractor.gvi"(Light calibration data=w31) -> (End Wavelength (nm) Current Calibration=w33, Wavelength Step (nm) Current Calibration=w34, Start Wavelength (nm) Current Calibration=w35)
      call "Wavelength loop calculation.gvi"(Wavelength Step (nm)=w34, End Wavelength (nm)=w33, Start Wavelength (nm)=w35) -> (Ammount of steps +1 (for the loop)=w36, Positive or negative steps=w37, Exact ammount of steps=w38)
      call "Filter Wavelength nm Crossing ka.gvi"(Light Power Calibration Data=w31) -> (Crosses the Change Grating Wavelength Frontier?=w39)
      call "Filter Flipper arduino flip subroutine.gvi"(Start Wavelength (nm) Current Calibration=w35, Filter Arduino Status=w29, Arduino Filter Flipper Address=w30, Error In=w20) -> (Error Out=w40)
      call "Clear Buffer.gvi"(VISA resource name=w19, error in (no error)=w40) -> (VISA resource name out=w41, error out=w42)
      call "Configure Integration Filter.gvi"(VISA resource name=w41, Measurement Speed (1 PLC)=0.5, error in (no error)=w42) -> (VISA resource name out=w43, error out=w44)
      call "Enable Output.gvi"(VISA resource name=w43, Enable Output (T: Enable)=TRUE, error in (no error)=w44) -> (VISA resource name out=w45, error out=w46)
      s1 = w46  # shift register
      s2 = w21  # shift register
      s3 = w45  # shift register
      s4 = f64[][] []  # shift register
      s5 = $"Notifier In"  # shift register
      s6 = uninitialised  # shift register
      s6.prev1 = uninitialised  # shift register
      s6.prev2 = uninitialised  # shift register
      for (N = w36) (iteration -> i1) {
        Wait Until Next Multiple(multiple to wait=5)
        Multiply(w34, i1, w37) -> w47
        Add(w47, w35) -> w48
        # w49: Light power at current wavelength
        Property Node(instance in=$"Single acquire inputs control") -> ("Current Aveages"=w50, "Filter Arduino Status"=w51, "Arduino Filter Flipper Address"=w52, "Monocrhomator"=w53)
        Multiply(i1, w50) -> w54
        Increment(x=w54) -> w55
        Add(w54, w50) -> w56
        call "Current State FGV.gvi"(Instruction Current State FGV="Set Current SubState", Current SubState="Measuring with Keithley", Error In=s1) -> (Error Out=w57)
        call "Keithley adaptative measurement setup.gvi"(Keithley address in=s3, Last Measurement=s6, 2nd Last Measurement=s6.prev1, 3nd Last Measurement=s6.prev2, threshold=w32, loop iteration=i1, Error Out=w57, Single acquire inputs control=$"Single acquire inputs control") -> (Keythley address out=w58, Error In=w59)
        call "Wavelength detection filter flipper routine.gvi"(Current Wavelength=w48, Arduino Filter Flipper Status=w51, Arduino Filter Flipper Address=w52, Crossing Ka=w39, Error In=w59) -> (Error Out=w60)
        call "Set Wavelength Function.gvi"(PE Fiannium Handle In=s2, Wavelength=w48, Monochromator=w53, Error In=w60) -> (PE Fiannium Handle Out=w61, Error Out=w62)
        call "Global Abort.gvi"(Instruction="Read Abort State", Error In=w62) -> (Local Abort State=w63, Global Abort State=w64, Error Out=w65)
        # w55: Buffer start index
        # w56: Buffer end index
        call "Skip To next Cell FGV.gvi"(General instruction FGV enum="Read state", Error In=w65) -> (Skip cell? out=w66, Error Out=w67)
        call "Make Reading and Store in Buffer.gvi"(VISA resource name=w58, error in (no error)=w67) -> (VISA resource name out=w68, error out=w69)
        call "Read (Multiple Points).gvi"(VISA resource name=w68, Timeout (10000 ms)=30000, Start Index (1)=w55, End Index (1)=w56, error in (no error)=w69) -> (VISA resource name out=w70, Data out=w71, error out=w72)
        Spreadsheet String To Array(array type=f64[] [], delimiter=",", format string="%g", spreadsheet string=w71) -> (array=w73)
        call "Mean (DBL).gvi"(x=w73, error in=w72) -> (mean=w74, error out=w75)
        Divide(x=1240, y=w48) -> w76
        Array Index(array=w31) -> (out0[i1, 1]=w49)
        # w74: Current (A)
        Divide(x=w74, y=w49) -> w77
        Multiply(w77, w76, 100) -> w78
        # w79: EQE (%)
        Absolute Value(x=w78) -> w79
        Build Array(w48, w79, w74) -> w80
        Insert Into Array(inArray=s4, index0=i1, new=w80) -> w81
        $"spreadsheet string" <- w71
        $"Current measurements" <- w73
        Absolute Value(x=w74) -> w82
        Divide(x=i1, y=w36) -> w83
        Multiply(w83, 100) -> w84
        Is Greater Or Equal(x=i1, y=w38) -> w85
        Logical Or(w63, w64, w66) -> w86
        Logical Or(w85, w86) -> w87
        w88 = "Single Acquire Notification control.gtype" {all zero or empty}
        Property Node(instance in=w88, "Wavelength (nm)"=w48, "EQE (%)"=w79, "Current (A)"=w74, "Finnished"=w87, "Progress"=w84) -> (instance out=w89)
        Send Notification(error in (no error)=w75, notification=w89, notifier=s5) -> (error out=w90, notifier out=w91)
        call "Erase Notification Error.gvi"(error out_2=w90) -> (Output=w92)
        next s1 = w92
        next s2 = w61
        next s3 = w70
        next s4 = w81
        next s5 = w91
        next s6 = w82
        stop if w86
      }
      Property Node(instance in=$"Single acquire inputs control") -> ("Automatic measurement"=w93)
      call "Skip To next Cell FGV.gvi"(General instruction FGV enum="Reset State", Error In=s1) -> (Error Out=w94)
      call "Enable Output.gvi"(VISA resource name=s3, Enable Output (T: Enable)=FALSE, error in (no error)=w94) -> (VISA resource name out=w95, error out=w96)
      call "Clear Buffer.gvi"(VISA resource name=w95, error in (no error)=w96) -> (VISA resource name out=w97, error out=w98)
      case (w93) {
        frame True {
          # If it is an automatic measurement
          # we leave the keithley running
          # and also the monochromator
          w27 = w98
        }
        frame False {
          call "Close.gvi"(VISA resource name=w97, error in (no error)=w98) -> (error out=w99)
          call "PE Close.gvi"(peHandle=s2, error in (no error)=w99) -> (peHandle out=w100, error out=w101)
          call "PE Destroy.gvi"(peHandle=w100, error in (no error)=w101) -> (error out=w27)
        }
      }
      $"Full EQE Data" <- s4
      $"Notifier Out" <- s5
    }
  }
  $"Error Out" <- w27
